# Dynamo graph Excel_IO-211020.dyn (Dynamo 2.10.0.3455)

excel_file_path = StringInput("F:\_NGHIEN CUU\_Github\py_dynamo_revit\excel_IO\Book1.xlsx")
sheet_name = StringInput("Sheet1")
show_excel = BoolSelector(true)
python_script = Python(IN[0]=excel_file_path, IN[1]=sheet_name, IN[2]=show_excel)  # IronPython2
# ---------- python_script.python (46 lines) ----------
import clr, time
clr.AddReference("Microsoft.Office.Interop.Excel")
# from System.Runtime.InteropServices import Marshal
import Microsoft.Office.Interop.Excel as Excel

excel_path = IN[0]
sheet_name = IN[1]
show_excel = IN[2]

debugger = []

# Excel app đã khởi tạo + chạy ngầm
excel_app = Excel.ApplicationClass()
# Hiện Excel
excel_app.Visible = show_excel

# Duyệt workbooks
workbook = excel_app.Workbooks
# Mở 1 file excel cụ thể
workbook = workbook.Open(excel_path)
worksheets = workbook.Worksheets
sheet = [worksheets(i+1) for i in range(worksheets.Count) if worksheets(i+1).Name == sheet_name][0]

row = 7
column = 2

# write excel:
sheet.Cells(row+2,column).Value = "Something New"


dic_data = {}
for r in range(1,row+1):
    try:
        dic_data[str(r)] = [sheet.Cells(r,c).Text for c in range(1,column+1)]
        # debugger.append(sheet.Cells(r,column).Text)
    except:
        pass

sheet.Cells(r,c)

OUT = dic_data
workbook.Close(True,excel_path)

if not show_excel:
	time.sleep(5)
	excel_app.Quit()
# ----------------------------------------
watch = Watch(python_script)
exportExcel = Data.ExportExcel()  # unwired: filePath, sheetName, startRow, startCol, data
importExcel = Data.ImportExcel()  # unwired: file, sheetName
